# Grasshopper definition cluster_git_v1.gh (Grasshopper 1.0.8)
# plug-ins: MetaHopper, Telepathy

# Plugin Libraries Used: MetaHopper | ver: 1.2.4
# Telepathy | ver:
# All Components Used: Sun Jul 27 15:59:53 2025
# Last saved by - user
# Total Components - 35
# OTools:
# ...3 | Debugging:
# ......OTools_GetComponents2 - 1
# Sets:
# ...Text:
# ......Match Text - 3
# ...Sequence:
# ......Cull Pattern - 3
# MetaHopper:
# ...Attributes:
# ......Set Group Properties - 3
# ...Object Retrieval:
# ......Get Groups - 1
# Metahopper:
# ...Utility:
# ......Label Groups - 1
# Params:
# ...Input:
# ......Button - 1
# ......Panel - 5
# ......Colour Swatch - 7
# ...Util:
# ......Scribble - 8
# ...Telepathy:
# ......Remote Receiver - 1
# ......Remote Sender - 1
button = Button()
# < SCRIPT TITLE >
# 
# Project: ###
# Author: ###
# Date Created: ###
# Script Description
# Explain the basics of your script here.
# RHINO FILE
# DATASET
o_getcomps2 = OTools_GetComponents2(x=button)  # inputs x: Boolean; plug-in component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

# ---- group: REMOTE
# Type0 Computation
# Generic
# - Use remote sender & receiver
#  for all major parameters
# 
# 
# 
# - Cluster repeatable functions.
unset = RemoteSender()
remote_receiver = RemoteReceiver()

# ----
groups = GetGroups()  # -> Groups, GroupStyles, Nickname, Color
hi = Abv()

# ---- group: Generic
# Script Template
# Author: Julius
# Last Updated: 25/07/27
# Colour Coding Convention
swatch = ColourSwatch(SwatchColor=RGBA(255, 255, 255, 130))

# ----
tmatch = MatchText(Text=groups.Nickname, Pattern="C - *", Case=True)
cull = CullPattern(List=groups.Groups, CullPattern=tmatch)
setgroup = SetGroupProperties(Group=cull, Color=ColourSwatch(SwatchColor=RGBA(255, 0, 0, 130)))

tmatch_2 = MatchText(Text=groups.Nickname, Pattern="P - *", Case=True)
cull_2 = CullPattern(List=groups.Groups, CullPattern=tmatch_2)
setgroup_2 = SetGroupProperties(Group=cull_2, Color=ColourSwatch(SwatchColor=RGBA(255, 255, 0, 130)))

# ---- group: C - Critical
swatch_2 = ColourSwatch(SwatchColor=RGBA(255, 0, 0, 130))

# ----
path = FilePath("C:\Users\juliu\Desktop\Dev\gh_cluster_git\json\")
py3 = Python3Script(Export=Button(), Path="C:\Users\juliu\Desktop\Dev\gh_cluster_git\json")  # -> out, Json; inputs Export: Boolean, Path: String; same code as py3_2
it_s_me = HI(B=Slider(7, range=0..10))

# ---- group: P - Preview
swatch_3 = ColourSwatch(SwatchColor=RGBA(255, 255, 0, 130))

# ---- group: I - Info
swatch_4 = ColourSwatch(SwatchColor=RGBA(128, 255, 255, 130))

# ----
tmatch_3 = MatchText(Text=groups.Nickname, Pattern="I - *", Case=True)
cull_3 = CullPattern(List=groups.Groups, CullPattern=tmatch_3)
# Naming Convention
# SIZE 40  - SECTION
# SIZE 25  - GROUPS
setgroup_3 = SetGroupProperties(Group=cull_3, Color=ColourSwatch(SwatchColor=RGBA(128, 255, 255, 130)))

panel = Panel(py3.Json)

# ==== cluster Abv
A = ClusterInput()
multiplication = Multiplication(A=A, B=Slider(7, range=0..10))
box = CenterBox(Base=PlaneXY(0, 0, 0), X=multiplication, Y=multiplication, Z=multiplication)
B = ClusterOutput(box)

# ==== cluster HI
py3 = Python3Script(
    Run=Button(),
    RepoPath="C:\Users\juliu\Desktop\Dev\gh_cluster_git",
    JsonRelPath="json/[Edit_ it's me]_.graph.json",
    Select=Toggle(True),
    Badges=Toggle(True))  # -> out, Summary, ChangedIds; inputs Run: Boolean, RepoPath: String, JsonRelPath: String, Select: Boolean, Badges: Boolean, ClearSelection: Boolean
# ---------- py3: Python ----------
import json
import System
import System.IO
from System.Diagnostics import Process, ProcessStartInfo

import Grasshopper
from Grasshopper.Kernel import IGH_Component
from Grasshopper.Kernel import GH_RuntimeMessageLevel

# ---------------- helpers ----------------

def strip_bom(s):
    # UTF-8 BOM can appear as \ufeff at start (you saw it as ﻿{ )
    if s is None:
        return s
    try:
        return s.lstrip(u"\ufeff")
    except:
        return s

def safe_load_json(text, label):
    try:
        t = strip_bom(text)
        if t is None:
            raise Exception("No content.")
        t = t.lstrip()
        if t == "":
            raise Exception("Empty content.")
        return json.loads(t)
    except Exception as e:
        raise Exception("Failed to parse JSON ({0}): {1}".format(label, str(e)))

def git_show(repo_path, git_ref, rel_path):
    # returns file content at git_ref:rel_path
    psi = ProcessStartInfo()
    psi.FileName = "git"
    psi.Arguments = 'show {0}:"{1}"'.format(git_ref, rel_path)
    psi.WorkingDirectory = repo_path
    psi.UseShellExecute = False
    psi.RedirectStandardOutput = True
    psi.RedirectStandardError = True
    psi.CreateNoWindow = True

    p = Process()
    p.StartInfo = psi
    p.Start()

    out = p.StandardOutput.ReadToEnd()
    err = p.StandardError.ReadToEnd()
    p.WaitForExit()

    if p.ExitCode != 0:
        raise Exception("git show failed: " + err)

    return out

def read_text(abs_path):
    # Read as bytes then decode to handle BOM reliably
    b = System.IO.File.ReadAllBytes(abs_path)
    # UTF-8 decode (BOM is fine; we strip anyway)
    try:
        s = System.Text.Encoding.UTF8.GetString(b)
    except:
        # fallback
        s = System.Text.Encoding.Default.GetString(b)
    return s

def node_signature(n):
    # What counts as a node "change"
    t = n.get("type", "")
    name = n.get("name", "")
    ins = n.get("inputs", [])
    outs = n.get("outputs", [])

    in_sig = []
    for p in ins:
        in_sig.append((p.get("name",""), p.get("nickname",""), p.get("type",""), p.get("access","")))
    out_sig = []
    for p in outs:
        out_sig.append((p.get("name",""), p.get("nickname",""), p.get("type",""), p.get("access","")))

    return (t, name, tuple(in_sig), tuple(out_sig))

def wire_signature(w):
    return (w.get("fromNode",""),
            int(w.get("fromIndex",-1)),
            w.get("toNode",""),
            int(w.get("toIndex",-1)))

def compute_diff(old_data, new_data):
    old_nodes = {}
    for n in old_data.get("nodes", []):
        old_nodes[n.get("id","")] = n

    new_nodes = {}
    for n in new_data.get("nodes", []):
        new_nodes[n.get("id","")] = n

    old_ids = set(old_nodes.keys())
    new_ids = set(new_nodes.keys())

    added = new_ids - old_ids
    removed = old_ids - new_ids

    changed = set()
    common = old_ids.intersection(new_ids)
    for nid in common:
        if node_signature(old_nodes[nid]) != node_signature(new_nodes[nid]):
            changed.add(nid)

    old_wires = set([wire_signature(w) for w in old_data.get("wires", [])])
    new_wires = set([wire_signature(w) for w in new_data.get("wires", [])])

    w_added = new_wires - old_wires
    w_removed = old_wires - new_wires

    # nodes touched by wire changes
    wire_touched = set()
    for w in list(w_added) + list(w_removed):
        wire_touched.add(w[0])  # fromNode
        wire_touched.add(w[2])  # toNode

    # highlight set (only nodes that exist in new doc)
    highlight = set()
    highlight |= added
    highlight |= changed
    highlight |= (wire_touched & new_ids)

    return added, removed, changed, w_added, w_removed, highlight

def highlight_on_canvas(highlight_ids, select, badges, clear_selection):
    doc = ghenv.Component.OnPingDocument()
    if doc is None:
        return

    if clear_selection:
        for obj in doc.Objects:
            try:
                obj.Attributes.Selected = False
            except:
                pass

    for obj in doc.Objects:
        oid = str(obj.InstanceGuid)
        if oid in highlight_ids:
            if select:
                try:
                    obj.Attributes.Selected = True
                except:
                    pass

            if badges:
                comp = obj if isinstance(obj, IGH_Component) else None
                if comp is not None:
                    try:
                        comp.AddRuntimeMessage(GH_RuntimeMessageLevel.Warning, "CHANGED")
                    except:
                        pass

    try:
        Grasshopper.Instances.ActiveCanvas.Refresh()
    except:
        pass


# ---------------- MAIN ----------------

Summary = ""
ChangedIds = []

if Run:
    if RepoPath is None or str(RepoPath).strip() == "":
        raise Exception("RepoPath is empty. Use the repo root, e.g. C:\\...\\gh_cluster_git")
    if JsonRelPath is None or str(JsonRelPath).strip() == "":
        raise Exception("JsonRelPath is empty. e.g. json/[Edit_ it's me]_.graph.json")

    repo = str(RepoPath).strip()

    rel = str(JsonRelPath).strip()
    # Git wants forward slashes
    rel = rel.replace("\\", "/")

    # OLD: last commit (HEAD)
    old_text = git_show(repo, "HEAD", rel)
    old_text = strip_bom(old_text)

    # NEW: working copy on disk
    new_abs = System.IO.Path.Combine(repo, rel.replace("/", System.IO.Path.DirectorySeparatorChar))
    if not System.IO.File.Exists(new_abs):
        raise Exception("Working copy JSON not found: " + new_abs)

    new_text = read_text(new_abs)
    new_text = strip_bom(new_text)

    old_data = safe_load_json(old_text, "HEAD")
    new_data = safe_load_json(new_text, "working copy")

    added, removed, changed, w_added, w_removed, highlight = compute_diff(old_data, new_data)

    ChangedIds = sorted(list(highlight))

    Summary = "Nodes: +{0} added, -{1} removed, ~{2} changed | Wires: +{3}/-{4} | Highlight: {5}".format(
        len(added), len(removed), len(changed), len(w_added), len(w_removed), len(highlight)
    )

    highlight_on_canvas(highlight, Select, Badges, ClearSelection)
# ---------- end py3 ----------
panel = Panel("abc")
py3_2 = Python3Script(Export=Button(), Path="C:\Users\juliu\Desktop\Dev\gh_cluster_git\json")  # -> out, Json; inputs Export: Boolean, Path: String
# ---------- py3_2: Python ----------
import json
import System
from System.IO import File, Directory
from System.Text import Encoding

import Grasshopper
from Grasshopper.Kernel import IGH_Component, IGH_Param

def _access_to_string(a):
    # GH_ParamAccess enum -> stable strings
    try:
        name = a.ToString().lower()
        # common values: item, list, tree
        return name
    except:
        return "unknown"

def _param_to_info(p):
    info = {}
    info["name"] = p.Name if p.Name else ""
    info["nickname"] = p.NickName if p.NickName else ""
    try:
        info["type"] = p.TypeName if p.TypeName else p.GetType().FullName
    except:
        info["type"] = p.GetType().FullName
    try:
        info["access"] = _access_to_string(p.Access)
    except:
        info["access"] = "unknown"
    return info

def _is_component(obj):
    try:
        return isinstance(obj, IGH_Component)
    except:
        return False

def _is_param(obj):
    try:
        return isinstance(obj, IGH_Param)
    except:
        return False

def export_graph(doc):
    export = {}
    export["schema"] = "gh-cluster-graph-v1"
    export["exportedAtUtc"] = System.DateTime.UtcNow.ToString("o")
    export["documentName"] = doc.DisplayName if doc.DisplayName else ""
    export["nodes"] = []
    export["wires"] = []

    # Collect nodes (components + params like sliders/panels/params)
    node_map = {}  # guid string -> node dict

    for obj in doc.Objects:
        if not (_is_component(obj) or _is_param(obj)):
            continue

        node = {}
        node_id = str(obj.InstanceGuid)
        node["id"] = node_id
        node["type"] = obj.GetType().FullName
        node["name"] = (obj.NickName if obj.NickName else (obj.Name if obj.Name else ""))
        node["inputs"] = []
        node["outputs"] = []

        if _is_component(obj):
            comp = obj
            # Inputs / outputs metadata
            try:
                for p in comp.Params.Input:
                    node["inputs"].append(_param_to_info(p))
                for p in comp.Params.Output:
                    node["outputs"].append(_param_to_info(p))
            except:
                pass

        # Standalone params (sliders/panels/etc.) still get recorded as nodes
        node_map[node_id] = node
        export["nodes"].append(node)

    # Collect wires: for each component input param, record its sources
    for obj in doc.Objects:
        if not _is_component(obj):
            continue

        comp = obj
        to_node_id = str(comp.InstanceGuid)

        try:
            inputs = comp.Params.Input
        except:
            inputs = []

        for to_index in range(len(inputs)):
            to_param = inputs[to_index]
            if to_param is None:
                continue

            try:
                sources = to_param.Sources
            except:
                sources = None

            if not sources:
                continue

            for from_param in sources:
                if from_param is None:
                    continue

                # Source could be:
                # - a component output param (from_param.Owner is component)
                # - a standalone param object (slider/panel/param), where Owner may be None
                from_index = -1

                try:
                    owner = from_param.Owner  # component if it's a component output
                except:
                    owner = None

                if owner is not None and _is_component(owner):
                    from_node_id = str(owner.InstanceGuid)
                    # find which output index
                    try:
                        from_index = owner.Params.Output.IndexOf(from_param)
                    except:
                        from_index = -1
                else:
                    # standalone param node
                    try:
                        from_node_id = str(from_param.InstanceGuid)
                    except:
                        # fallback: skip if we can't identify
                        continue
                    from_index = 0

                wire = {}
                wire["fromNode"] = from_node_id
                wire["fromIndex"] = int(from_index)
                wire["toNode"] = to_node_id
                wire["toIndex"] = int(to_index)
                export["wires"].append(wire)

    # Sort for stable diffs
    export["nodes"].sort(key=lambda n: n.get("id", ""))
    export["wires"].sort(key=lambda w: (
        w.get("fromNode", ""),
        int(w.get("fromIndex", -1)),
        w.get("toNode", ""),
        int(w.get("toIndex", -1))
    ))

    return export

# --- Main ---
doc = ghenv.Component.OnPingDocument()
data = export_graph(doc)

# Pretty JSON (diff-friendly)
json_text = json.dumps(data, indent=2, sort_keys=True)

Json = json_text  # output

# Write file if requested
if Export and Path and Path.strip() != "":
    p = Path.strip()

    # If user passed a folder (existing), write a file inside it
    if Directory.Exists(p):
        safe_name = doc.DisplayName if doc and doc.DisplayName else "gh_doc"
        # make it filename-safe-ish
        for ch in ['\\','/',';',':','*','?','"','<','>','|']:
            safe_name = safe_name.replace(ch, "_")
        filename = safe_name + ".graph.json"
        p = System.IO.Path.Combine(p, filename)

    # If user passed something without an extension, assume it's a folder path
    # (common when user types ...\json)
    else:
        ext = System.IO.Path.GetExtension(p)
        if ext == "":
            if not Directory.Exists(p):
                Directory.CreateDirectory(p)
            safe_name = doc.DisplayName if doc and doc.DisplayName else "gh_doc"
            for ch in ['\\','/',';',':','*','?','"','<','>','|']:
                safe_name = safe_name.replace(ch, "_")
            filename = safe_name + ".graph.json"
            p = System.IO.Path.Combine(p, filename)
        else:
            folder = System.IO.Path.GetDirectoryName(p)
            if folder and not Directory.Exists(folder):
                Directory.CreateDirectory(folder)

    File.WriteAllText(p, json_text, Encoding.UTF8)
# ---------- end py3_2 ----------
B = ClusterInput()
multiplication = Multiplication(B=B)
box = CenterBox(Base=PlaneXY(0, 0, 0), X=multiplication, Y=multiplication, Z=multiplication)
B_2 = ClusterOutput(box)
